% Simulink data dictionary EHB_data.sldd

R = [5.5553 5.7353 5.922 6.1156 6.3166 6.5252 6.7418 6.9666 7.2 7.4424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 2092.3003]
T = [100 99 98 97 96 95 94 93 92 91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 -30]
Cos_Table = mpt.Parameter([1 0.998 0.992 0.9819 0.9679 0.9501 0.9284 0.9029 0.8739 0.8413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 1], StorageClass="Global", DataType="fixdt(1,16,14)")
Sin_BreakPoint = mpt.Parameter([0 0.0635 0.1269 0.1904 0.2539 0.3173 0.3808 0.4443 0.5077 0.5712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 6.2832], StorageClass="Global", DataType="single")
Sin_Table = mpt.Parameter([0 0.0635 0.1266 0.1893 0.2512 0.312 0.3717 0.4298 0.4862 0.5406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 0], StorageClass="Global", DataType="fixdt(1,16,14)")
Param = Simulink.Parameter([], StorageClass="Volatile", DataType="uint16")